# Grasshopper definition PenroseTiling_CSscriptComp.gh (Grasshopper 1.0.7)

# ---- group: Rules
# (eliminate at each iteration)
panel = Panel("+ ->")
panel_2 = Panel("- ->")
panel_3 = Panel("1 ->")
panel_4 = Panel("6 ->")
panel_5 = Panel("7 ->")
panel_6 = Panel("8 ->")
panel_7 = Panel("9 ->")
panel_9 = Panel("--81++++61[+91++++71]--71")
panel_10 = Panel("81++91----71[-81----61]++")
panel_11 = Panel("-61++71[+++81++91]-")
panel_12 = Panel("+81--91[---61--71]+")
panel_13 = Panel("Rotate 36")
panel_14 = Panel("Rotate -36")
panel_15 = Panel("Draw Forward")

# ---- group: Starting string
panel_16 = Panel("[7]++[7]++[7]++[7]++[7]")

# ---- group: Contents
panel_17 = Panel("+ -")

# ---- group: Variables
# L-Sytems Definition - Penrose Tiling
panel_18 = Panel("1, 6, 7, 8, 9, [, ]")

# ----
num = Slider(1, range=1..5)
length = Slider(4.2254, range=1..10)
c_script = CSharpScript(startString=panel_16, rule6=panel_10, rule7=panel_12, rule8=panel_11, rule9=panel_9, num=num, length=length)  # -> out, PenroseString, PenroseLines; inputs startString: String, rule6: String, rule7: String, rule8: String, rule9: String, num: Int32, length: Double
# ---------- c_script: C# ----------
    //Declare string
    string finalString;
    finalString = startString;
    //Generate the string
    GrowString(ref num, ref finalString, rule6, rule7, rule8, rule9);
    //Generate the points
    var penroseLines = new List<Line>();
    ParsepenroseString(finalString, length, ref penroseLines);


    //Assign output
    PenroseString = finalString;
    PenroseLines = penroseLines;
# ---------- c_script: C# additional code ----------
  private void GrowString(ref int num, ref string finalString, string rule6, string rule7, string rule8, string rule9)
  {
    //Decrement the count with each new execution of the grow function
    num = num - 1;
    char rule;

    //Create new string
    string newString = "";
    for(int i = 0; i < finalString.Length; i++)
    {
      rule = finalString[i];
      if(rule == '6')
      {
        newString = newString + rule6;
      }
      if(rule == '7')
      {
        newString = newString + rule7;
      }
      if(rule == '8')
      {
        newString = newString + rule8;
      }
      if(rule == '9')
      {
        newString = newString + rule9;
      }

      if(rule == '[' || rule == ']' || rule == '+' ||rule == '-')
      {
        newString = newString + rule;
      }
    }
    finalString = newString;

    //Stop condition
    if(num == 0){return;}

    //Grow agein(recursive)
    GrowString(ref num, ref finalString, rule6, rule7, rule8, rule9);
  }

  private void ParsepenroseString(string penroseString, double length, ref List<Line> penroseLines)
  {
    //Parse instruction string to generate points
    //Let base point be world origin
    var pt = Point3d.Origin;

    //Declare points list
    //Vector rotate with (+.-) instruction by 36degrees
    var listPts = new List<Point3d>();

    //Draw forward direction
    //Vector direction will be rotated depend on (+, -) instructions
    var vec = new Vector3d(1.0, 0.0, 0.0);

    //Stacks of points and vectors
    var ptStack = new List<Point3d>();
    var vStack = new List<Vector3d>();

    //Declare loop variables
    char rule;
    for(int i = 0; i < penroseString.Length; i++)
    {
      //Always start for 1 and length  1 to get one char at a time
      rule = penroseString[i];

      //rotate left
      if(rule == '+')
      {
        vec.Rotate(36 * (Math.PI / 180), Vector3d.ZAxis);
      }
      //rotate right
      if(rule == '-')
      {
        vec.Rotate(-36 * (Math.PI / 180), Vector3d.ZAxis);
      }
      //draw forward by direction
      if(rule == '1')
      {
        //Add current points
        var newPt1 = new Point3d(pt);
        listPts.Add(newPt1);

        //Calculate next point
        var newPt2 = pt + (vec * length);
        //Add next point
        listPts.Add(newPt2);

        //Save new location
        pt = newPt2;
      }

      //Save point location
      if(rule == '[')
      {
        //Save current point and direction
        var newPt = new Point3d(pt);
        ptStack.Add(newPt);

        var newVec = new Vector3d(vec);
        vStack.Add(newVec);
      }
      //Retrieve point and directon
      if(rule == ']')
      {
        pt = ptStack[ptStack.Count - 1];
        vec = vStack[vStack.Count - 1];
        //Remove from stack
        ptStack.RemoveAt(ptStack.Count - 1);
        vStack.RemoveAt(vStack.Count - 1);
      }
    }

    //Generate lines
    var allLines = new List<Line>();
    for(int i = 1; i < listPts.Count; i = i + 2)
    {
      var line = new Line(listPts[i - 1], listPts[i]);
      allLines.Add(line);
    }

    penroseLines = allLines;

    Print(allLines.Count.ToString());


  }
# ---------- end c_script ----------
panel_19 = Panel(c_script.out)
